# Grasshopper definition green.gh (Grasshopper 1.0.8)

number_slider = Slider(5, range=0..10)
number_slider_2 = Slider(0.69, range=0..1)
number_slider_3 = Slider(12, range=0..100)
number_slider_4 = Slider(3, range=0..10)
number_slider_5 = Slider(16, range=0..100)
number_slider_6 = Slider(4, range=0..10)
c_script = CSharpScript(
    W=number_slider_5,
    FloorH=number_slider_3,
    Levels=number_slider_4,
    CorridorD=Slider(5, range=0..10),
    MeshGap=Slider(0.5, range=0..10),
    PlantersPerLevel=number_slider,
    PlanterScale=Slider(1, range=0..10),
    Organic=number_slider_2,
    Seed=number_slider_6)  # -> SectionGuides, PrimaryStructure, SpandrelEnvelope, CorridorStructure, GlazingSystem, Armature, MeshInfill, PocketModules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; inputs W: Double, FloorH: Double, Levels: Int32, CorridorD: Double, MeshGap: Double, PlantersPerLevel: Int32, PlanterScale: Double, Organic: Double, Seed: Int32
# ---------- c_script: C# ----------
// Grasshopper Script Instance
// V9: dimension-schedule driven facade bay
//
// Inputs:
// W double, FloorH double, Levels int, CorridorD double, MeshGap double,
// PlantersPerLevel int, PlanterScale double, Organic double, Seed int
//
// Outputs, in this exact order. Keep ALL output type hints as Generic / No Type Hint:
// SectionGuides
// PrimaryStructure
// SpandrelEnvelope
// CorridorStructure
// GlazingSystem
// Armature
// MeshInfill
// PocketModules
// PocketSupports
// Plants
// Roof

#region Usings
using System;
using System.Linq;
using System.Collections;
using System.Collections.Generic;
using System.Drawing;

using Rhino;
using Rhino.Geometry;

using Grasshopper;
using Grasshopper.Kernel;
using Grasshopper.Kernel.Data;
using Grasshopper.Kernel.Types;
#endregion

public class Script_Instance : GH_ScriptInstance
{
  private void RunScript(
		double W,
		double FloorH,
		int Levels,
		double CorridorD,
		double MeshGap,
		int PlantersPerLevel,
		double PlanterScale,
		double Organic,
		int Seed,
		ref object SectionGuides,
		ref object PrimaryStructure,
		ref object SpandrelEnvelope,
		ref object CorridorStructure,
		ref object GlazingSystem,
		ref object Armature,
		ref object MeshInfill,
		ref object PocketModules,
		ref object PocketSupports,
		ref object Plants,
		ref object Roof)
  {
    W = Math.Max(W, 10.0);
    FloorH = Math.Max(FloorH, 9.0);
    Levels = Math.Max(Levels, 1);
    CorridorD = Math.Max(CorridorD, 3.0);
    MeshGap = Math.Max(MeshGap, 0.8);
    PlantersPerLevel = Math.Max(PlantersPerLevel, 1);
    PlanterScale = Math.Max(PlanterScale, 0.65);
    Organic = Math.Max(0.0, Math.Min(Organic, 1.0));

    var guides = new List<object>();
    var primary = new List<object>();
    var spandrel = new List<object>();
    var corridor = new List<object>();
    var glazing = new List<object>();
    var armature = new List<object>();
    var mesh = new List<object>();
    var pockets = new List<object>();
    var pocketSupports = new List<object>();
    var plants = new List<object>();
    var roof = new List<object>();

    // ------------------------------------------------------------
    // DIMENSION SCHEDULE, FEET
    // Y is locked by this schedule. Inputs mainly affect X/Z repetition.
    // ------------------------------------------------------------
    double xL = -W * 0.5;
    double xR = W * 0.5;
    double bayL = -W * 0.62;
    double bayR = W * 0.62;
    double totalH = Levels * FloorH;

    // Building structure.
    double structureFaceY = 0.00;
    double interiorY = 7.00;
    double slabT = 0.50;
    double edgeBeamW = 1.00;   // Y width, inward from structure face
    double edgeBeamD = 1.50;   // Z depth

    // Envelope and glazing.
    double spandrelT = 0.18;
    double spandrelOuterY = structureFaceY - spandrelT;
    double spandrelInnerY = structureFaceY;
    double glazingOuterY = spandrelOuterY;
    double glazingInnerY = structureFaceY + 0.02;
    double spandrelAboveFFL = 0.70;
    double spandrelBelowFFL = slabT + edgeBeamD + 0.18;

    // Corridor.
    double thermalGap = 0.50;
    double corridorInnerY = spandrelOuterY - thermalGap;
    double corridorOuterY = corridorInnerY - CorridorD;
    double deckT = 0.33;
    double deckDrop = 0.10;
    double corridorBeamW = 0.50; // Y width
    double corridorBeamD = 0.75; // Z depth

    // Armature and mesh.
    double armatureY = corridorOuterY - MeshGap;
    double meshY = armatureY - 0.04;
    double postR = 0.08;
    double railR = 0.06;
    double meshR = 0.025;

    // Section guides.
    AddGuide(guides, "structureFace", structureFaceY, 0, totalH);
    AddGuide(guides, "spandrelOuter", spandrelOuterY, 0, totalH);
    AddGuide(guides, "corridorInner", corridorInnerY, 0, totalH);
    AddGuide(guides, "corridorOuter", corridorOuterY, 0, totalH);
    AddGuide(guides, "armature", armatureY, 0, totalH);

    for (int i = 0; i <= Levels; i++)
    {
      double ffl = i * FloorH;
      guides.Add(new LineCurve(new Point3d(xL, spandrelOuterY - 0.4, ffl), new Point3d(xR, interiorY, ffl)));
      guides.Add(new LineCurve(new Point3d(xL, spandrelOuterY - 0.4, ffl + spandrelAboveFFL), new Point3d(xR, interiorY, ffl + spandrelAboveFFL)));
      guides.Add(new LineCurve(new Point3d(xL, spandrelOuterY - 0.4, ffl - spandrelBelowFFL), new Point3d(xR, interiorY, ffl - spandrelBelowFFL)));
    }

    // ------------------------------------------------------------
    // PRIMARY STRUCTURE AND SPANDREL
    // ------------------------------------------------------------
    for (int i = 0; i <= Levels; i++)
    {
      double ffl = i * FloorH;
      double slabTop = ffl;
      double slabBottom = ffl - slabT;
      double beamTop = slabBottom;
      double beamBottom = beamTop - edgeBeamD;
      double spZ0 = ffl - spandrelBelowFFL;
      double spZ1 = ffl + spandrelAboveFFL;

      // Slab and edge beam share exterior face at Y=0.
      primary.Add(BoxBrep(new Point3d(bayL, structureFaceY, slabBottom), new Point3d(bayR, interiorY, slabTop)));
      primary.Add(BoxBrep(new Point3d(bayL, structureFaceY, beamBottom), new Point3d(bayR, structureFaceY + edgeBeamW, beamTop)));

      // Ribs stop at the inner face of edge beam.
      for (int b = 0; b <= 4; b++)
      {
        double x = bayL + (bayR - bayL) * b / 4.0;
        primary.Add(BoxBrep(new Point3d(x - 0.15, structureFaceY + edgeBeamW, slabBottom - 0.38), new Point3d(x + 0.15, interiorY, slabBottom)));
        primary.Add(BoxBrep(new Point3d(x - 0.13, structureFaceY + 0.04, slabBottom - 0.36), new Point3d(x + 0.13, structureFaceY + edgeBeamW + 0.04, slabBottom - 0.05)));
      }

      // Thin envelope cover, flush outside structure.
      spandrel.Add(BoxBrep(new Point3d(bayL - 0.03, spandrelOuterY, spZ0), new Point3d(bayR + 0.03, spandrelInnerY, spZ1)));
      spandrel.Add(BoxBrep(new Point3d(bayL - 0.05, spandrelOuterY - 0.035, spZ0 + 0.06), new Point3d(bayR + 0.05, spandrelOuterY + 0.025, spZ1 - 0.06)));

      // Curb/thermal break at FFL. This is thin and exterior to the structure face.
      spandrel.Add(BoxBrep(new Point3d(bayL, corridorInnerY, ffl - 0.08), new Point3d(bayR, spandrelOuterY, ffl + 0.35)));
    }

    // Glazing between spandrel bands.
    for (int i = 0; i < Levels; i++)
    {
      double sillZ = i * FloorH + spandrelAboveFFL;
      double headZ = (i + 1) * FloorH - spandrelBelowFFL;

      glazing.Add(BoxBrep(new Point3d(xL, glazingOuterY, sillZ), new Point3d(xR, glazingInnerY, headZ)));
      glazing.Add(BoxBrep(new Point3d(xL - 0.05, glazingOuterY - 0.02, sillZ - 0.05), new Point3d(xR + 0.05, glazingInnerY + 0.08, sillZ + 0.05)));
      glazing.Add(BoxBrep(new Point3d(xL - 0.05, glazingOuterY - 0.02, headZ - 0.05), new Point3d(xR + 0.05, glazingInnerY + 0.08, headZ + 0.05)));

      for (int m = 0; m <= 5; m++)
      {
        double x = xL + W * m / 5.0;
        glazing.Add(BoxBrep(new Point3d(x - 0.035, glazingOuterY - 0.02, sillZ), new Point3d(x + 0.035, glazingInnerY + 0.08, headZ)));
      }

      double midZ = (sillZ + headZ) * 0.5;
      glazing.Add(BoxBrep(new Point3d(xL - 0.05, glazingOuterY - 0.02, midZ - 0.028), new Point3d(xR + 0.05, glazingInnerY + 0.08, midZ + 0.028)));
    }

    // ------------------------------------------------------------
    // CORRIDOR STRUCTURE
    // ------------------------------------------------------------
    for (int i = 0; i <= Levels; i++)
    {
      double deckTop = i * FloorH - deckDrop;
      double deckBottom = deckTop - deckT;
      double beamBottom = deckTop - corridorBeamD;

      corridor.Add(BoxBrep(new Point3d(bayL, corridorOuterY, deckBottom), new Point3d(bayR, corridorInnerY, deckTop)));

      // Ledger and outer edge beams are under deck edges, not floating.
      corridor.Add(BoxBrep(new Point3d(bayL, corridorInnerY - corridorBeamW, beamBottom), new Point3d(bayR, corridorInnerY, deckBottom)));
      corridor.Add(BoxBrep(new Point3d(bayL, corridorOuterY, beamBottom), new Point3d(bayR, corridorOuterY + corridorBeamW, deckBottom)));

      for (int b = 0; b <= 4; b++)
      {
        double x = bayL + (bayR - bayL) * b / 4.0;
        corridor.Add(BoxBrep(new Point3d(x - 0.12, corridorOuterY + corridorBeamW, beamBottom), new Point3d(x + 0.12, corridorInnerY - corridorBeamW, deckBottom)));

        // Tie plate from ledger to curb.
        corridor.Add(BoxBrep(new Point3d(x - 0.10, corridorInnerY - corridorBeamW, beamBottom + 0.04), new Point3d(x + 0.10, spandrelOuterY, deckBottom + 0.02)));
      }
    }

    for (int i = 0; i < Levels; i++)
    {
      double deckTop = i * FloorH - deckDrop;
      double railZ = deckTop + 3.55;

      for (int b = 0; b <= 4; b++)
      {
        double x = bayL + (bayR - bayL) * b / 4.0;
        corridor.Add(BoxBrep(new Point3d(x - 0.04, corridorOuterY - 0.06, deckTop + 0.08), new Point3d(x + 0.04, corridorOuterY + 0.06, railZ)));
      }

      corridor.Add(CylinderBetween(new Point3d(bayL, corridorOuterY, railZ), new Point3d(bayR, corridorOuterY, railZ), 0.050));
      corridor.Add(CylinderBetween(new Point3d(bayL, corridorOuterY, deckTop + 1.85), new Point3d(bayR, corridorOuterY, deckTop + 1.85), 0.035));
    }

    // Roof.
    double roofFfl = totalH;
    roof.Add(BoxBrep(new Point3d(bayL, structureFaceY, roofFfl), new Point3d(bayR, interiorY, roofFfl + slabT)));
    roof.Add(BoxBrep(new Point3d(bayL, structureFaceY, roofFfl + slabT), new Point3d(bayR, interiorY, roofFfl + slabT + 0.44)));
    roof.Add(BoxBrep(new Point3d(bayL - 0.06, spandrelOuterY - 0.05, roofFfl + 0.24), new Point3d(bayR + 0.06, structureFaceY + 0.18, roofFfl + 1.22)));
    roof.Add(BoxBrep(new Point3d(bayL - 0.10, spandrelOuterY - 0.12, roofFfl + 1.22), new Point3d(bayR + 0.10, structureFaceY + 0.30, roofFfl + 1.36)));

    // ------------------------------------------------------------
    // ARMATURE AND MESH
    // ------------------------------------------------------------
    AddPipeRect(armature, bayL, armatureY, 0.0, bayR, totalH, postR);

    for (int p = 0; p <= 4; p++)
    {
      double x = bayL + (bayR - bayL) * p / 4.0;
      armature.Add(CylinderBetween(new Point3d(x, armatureY, 0.0), new Point3d(x, armatureY, totalH), postR));

      for (int i = 0; i <= Levels; i++)
      {
        double deckTop = i * FloorH - deckDrop;
        double beamZ = deckTop - corridorBeamD * 0.55;
        armature.Add(BoxBrep(new Point3d(x - 0.20, corridorOuterY + 0.08, beamZ - 0.04), new Point3d(x + 0.20, corridorOuterY + 0.32, beamZ + 0.08)));
        armature.Add(CylinderBetween(new Point3d(x, corridorOuterY + 0.20, beamZ), new Point3d(x, armatureY, beamZ), 0.055));
      }
    }

    for (int i = 0; i <= Levels; i++)
      armature.Add(CylinderBetween(new Point3d(bayL, armatureY, i * FloorH), new Point3d(bayR, armatureY, i * FloorH), railR));

    for (int i = 0; i < Levels; i++)
      armature.Add(CylinderBetween(new Point3d(bayL + 0.15, armatureY, i * FloorH + FloorH * 0.48), new Point3d(bayR - 0.15, armatureY, i * FloorH + FloorH * 0.48), railR));

    double cellX = W / 6.0;
    double cellZ = FloorH / 3.0;
    for (double x = bayL; x <= bayR; x += cellX)
    {
      for (double z = 0.0; z <= totalH - cellZ; z += cellZ)
      {
        Point3d a = new Point3d(x, meshY, z);
        Point3d b = new Point3d(x + cellX * 0.5, meshY, z + cellZ * 0.5);
        Point3d c = new Point3d(x, meshY, z + cellZ);
        Point3d d = new Point3d(x - cellX * 0.5, meshY, z + cellZ * 0.5);
        mesh.Add(CylinderBetween(a, b, meshR));
        mesh.Add(CylinderBetween(b, c, meshR));
        mesh.Add(CylinderBetween(c, d, meshR));
        mesh.Add(CylinderBetween(d, a, meshR));
      }
    }

    // ------------------------------------------------------------
    // ORGANIC POCKETS
    // ------------------------------------------------------------
    var random = new Random(Seed);
    double bayStep = W / PlantersPerLevel;

    for (int level = 0; level < Levels; level++)
    {
      double supportRailZ = level * FloorH + FloorH * 0.48;

      for (int j = 0; j < PlantersPerLevel; j++)
      {
        double baseX = xL + bayStep * (j + 0.5);
        double x = baseX + (random.NextDouble() - 0.5) * bayStep * 0.28 * Organic;
        double z = supportRailZ + (random.NextDouble() - 0.5) * FloorH * 0.14 * Organic;

        double width = bayStep * PlanterScale * (0.56 + random.NextDouble() * 0.22 * Organic);
        double height = FloorH * PlanterScale * (0.20 + random.NextDouble() * 0.07 * Organic);
        double depth = PlanterScale * (1.25 + random.NextDouble() * 0.40 * Organic);
        double shellT = 0.13 * PlanterScale;

        Point3d pocketCenter = new Point3d(x, armatureY - 0.18, z);

        pockets.Add(OrganicPocketBasin(pocketCenter, width, height, depth, shellT, Organic, Seed + level * 41 + j * 17));
        pockets.Add(BackSpine(pocketCenter, width, height, shellT, armatureY));

        List<Point3d> lipPts = PocketLipPoints(pocketCenter, width, height, depth, Organic, Seed + j * 13);
        for (int l = 0; l < lipPts.Count - 1; l++)
          pockets.Add(CylinderBetween(lipPts[l], lipPts[l + 1], Math.Max(0.080, shellT * 0.62)));

        pockets.Add(SoilSurfaceMesh(pocketCenter, width * 0.60, depth * 0.68, pocketCenter.Z + height * 0.20, pocketCenter.Y - depth * 0.72));
        foreach (Curve rib in PocketRibCurves(pocketCenter, width, height, depth, Organic, Seed + j * 19)) pockets.Add(rib);
        foreach (Curve hole in DrainHoleCurves(pocketCenter, width, height, depth)) pockets.Add(hole);

        pocketSupports.Add(BoxBrep(new Point3d(x - width * 0.32, armatureY - 0.09, supportRailZ - 0.075), new Point3d(x + width * 0.32, armatureY + 0.09, supportRailZ + 0.075)));
        pocketSupports.Add(BoxBrep(new Point3d(x - width * 0.30, armatureY + 0.07, z - height * 0.18), new Point3d(x + width * 0.30, armatureY + 0.25, z + height * 0.18)));
        pocketSupports.Add(CylinderBetween(new Point3d(x - width * 0.23, armatureY + 0.12, z - height * 0.10), new Point3d(x - width * 0.23, armatureY + 0.58, z - height * 0.10), 0.060));
        pocketSupports.Add(CylinderBetween(new Point3d(x + width * 0.23, armatureY + 0.12, z - height * 0.10), new Point3d(x + width * 0.23, armatureY + 0.58, z - height * 0.10), 0.060));

        List<Point3d> drip = new List<Point3d>();
        drip.Add(new Point3d(x - width * 0.25, pocketCenter.Y - depth * 0.60, z + height * 0.21));
        drip.Add(new Point3d(x - width * 0.08, pocketCenter.Y - depth * 0.74, z + height * 0.23));
        drip.Add(new Point3d(x + width * 0.10, pocketCenter.Y - depth * 0.73, z + height * 0.21));
        drip.Add(new Point3d(x + width * 0.25, pocketCenter.Y - depth * 0.60, z + height * 0.22));
        for (int q = 0; q < drip.Count - 1; q++) pockets.Add(CylinderBetween(drip[q], drip[q + 1], 0.025));

        for (int k = 0; k < 7; k++)
        {
          double px = x + (random.NextDouble() - 0.5) * width * 0.52;
          double py = pocketCenter.Y - depth * (0.58 + random.NextDouble() * 0.20);
          double pz = z + height * 0.12;
          double rise = 0.45 + random.NextDouble() * 1.05;

          plants.Add(new ArcCurve(new Arc(
            new Point3d(px, py, pz),
            new Point3d(px + (random.NextDouble() - 0.5) * 0.35, py - 0.10, pz + rise * 0.55),
            new Point3d(px + (random.NextDouble() - 0.5) * 0.65, py - 0.04, pz + rise))));

          var vine = new Polyline();
          vine.Add(new Point3d(px, py, pz));
          vine.Add(new Point3d(px + 0.16 * Math.Sin(k + Seed), pocketCenter.Y - depth * 0.22, pz + rise * 0.76));
          vine.Add(new Point3d(px + 0.30 * Math.Cos(k), meshY, pz + rise * 1.20));
          plants.Add(vine.ToNurbsCurve());
        }
      }
    }

    Print("Generated V9 dimension-schedule model.");

    SectionGuides = guides;
    PrimaryStructure = primary;
    SpandrelEnvelope = spandrel;
    CorridorStructure = corridor;
    GlazingSystem = glazing;
    Armature = armature;
    MeshInfill = mesh;
    PocketModules = pockets;
    PocketSupports = pocketSupports;
    Plants = plants;
    Roof = roof;
  }

  void AddGuide(List<object> target, string label, double y, double z0, double z1)
  {
    target.Add(new LineCurve(new Point3d(-0.35, y, z0), new Point3d(-0.35, y, z1)));
  }

  Brep BoxBrep(Point3d a, Point3d b)
  {
    var x = new Interval(Math.Min(a.X, b.X), Math.Max(a.X, b.X));
    var y = new Interval(Math.Min(a.Y, b.Y), Math.Max(a.Y, b.Y));
    var z = new Interval(Math.Min(a.Z, b.Z), Math.Max(a.Z, b.Z));
    return new Box(Plane.WorldXY, x, y, z).ToBrep();
  }

  Brep CylinderBetween(Point3d a, Point3d b, double radius)
  {
    Vector3d axis = b - a;
    double length = axis.Length;
    if (length < 0.0001) return null;
    axis.Unitize();
    Plane plane = new Plane(a, axis);
    return new Cylinder(new Circle(plane, radius), length).ToBrep(true, true);
  }

  void AddPipeRect(List<object> target, double x0, double y, double z0, double x1, double z1, double r)
  {
    Point3d a = new Point3d(x0, y, z0);
    Point3d b = new Point3d(x1, y, z0);
    Point3d c = new Point3d(x1, y, z1);
    Point3d d = new Point3d(x0, y, z1);
    target.Add(CylinderBetween(a, b, r));
    target.Add(CylinderBetween(b, c, r));
    target.Add(CylinderBetween(c, d, r));
    target.Add(CylinderBetween(d, a, r));
  }

  Brep BackSpine(Point3d c, double w, double h, double t, double armatureY)
  {
    return BoxBrep(
      new Point3d(c.X - w * 0.24, armatureY - 0.02, c.Z - h * 0.34),
      new Point3d(c.X + w * 0.24, armatureY + Math.Max(0.24, t * 1.7), c.Z + h * 0.34));
  }

  Mesh OrganicPocketBasin(Point3d c, double w, double h, double d, double t, double organic, int seed)
  {
    int uCount = 34;
    int vCount = 22;
    var mesh = new Mesh();

    for (int v = 0; v <= vCount; v++)
    {
      double tv = (double)v / vCount;

      double ySection;
      double zSection;
      if (tv < 0.28)
      {
        double s = tv / 0.28;
        ySection = c.Y + 0.03;
        zSection = c.Z + h * (0.52 - 0.72 * s);
      }
      else if (tv < 0.72)
      {
        double s = (tv - 0.28) / 0.44;
        ySection = c.Y - d * (0.12 + 0.88 * SmoothStep(0.0, 1.0, s));
        zSection = c.Z - h * 0.20 - h * 0.18 * Math.Sin(s * Math.PI);
      }
      else
      {
        double s = (tv - 0.72) / 0.28;
        ySection = c.Y - d * (1.00 - 0.12 * s);
        zSection = c.Z - h * 0.26 + h * 0.78 * SmoothStep(0.0, 1.0, s);
      }

      double widthFactor = 0.46 + 0.36 * Math.Sin(tv * Math.PI) + 0.18 * SmoothStep(0.65, 1.0, tv);

      for (int u = 0; u <= uCount; u++)
      {
        double tu = (double)u / uCount;
        double xNorm = (tu - 0.5) * 2.0;
        double wave = Math.Sin(tu * Math.PI * 2.2 + seed * 0.13) * Math.Sin(tv * Math.PI * 1.8 + seed * 0.07);

        double x = c.X + xNorm * w * 0.5 * widthFactor;
        double y = ySection + wave * d * 0.055 * organic;
        double z = zSection + wave * h * 0.045 * organic;
        mesh.Vertices.Add(x, y, z);
      }
    }

    int outerCount = mesh.Vertices.Count;
    for (int v = 0; v <= vCount; v++)
    {
      for (int u = 0; u <= uCount; u++)
      {
        Point3f p = mesh.Vertices[v * (uCount + 1) + u];
        double tu = (double)u / uCount;
        mesh.Vertices.Add(p.X - (tu - 0.5) * w * 0.05, p.Y + t, p.Z);
      }
    }

    for (int v = 0; v < vCount; v++)
    {
      for (int u = 0; u < uCount; u++)
      {
        int a = v * (uCount + 1) + u;
        int b = a + 1;
        int c0 = a + (uCount + 1);
        int d0 = c0 + 1;
        mesh.Faces.AddFace(a, b, d0, c0);
        mesh.Faces.AddFace(outerCount + a, outerCount + c0, outerCount + d0, outerCount + b);
      }
    }

    for (int v = 0; v < vCount; v++)
    {
      int left = v * (uCount + 1);
      int leftNext = (v + 1) * (uCount + 1);
      mesh.Faces.AddFace(left, outerCount + left, outerCount + leftNext, leftNext);

      int right = v * (uCount + 1) + uCount;
      int rightNext = (v + 1) * (uCount + 1) + uCount;
      mesh.Faces.AddFace(right, rightNext, outerCount + rightNext, outerCount + right);
    }

    mesh.Normals.ComputeNormals();
    mesh.Compact();
    return mesh;
  }

  Mesh SoilSurfaceMesh(Point3d c, double w, double d, double z, double y)
  {
    int segments = 32;
    var mesh = new Mesh();
    mesh.Vertices.Add(c.X, y, z);
    for (int i = 0; i <= segments; i++)
    {
      double t = Math.PI * 2.0 * i / segments;
      mesh.Vertices.Add(c.X + Math.Cos(t) * w * 0.5, y + Math.Sin(t) * d * 0.34, z + Math.Sin(t * 3.0) * 0.018);
    }
    for (int i = 1; i <= segments; i++) mesh.Faces.AddFace(0, i, i + 1);
    mesh.Normals.ComputeNormals();
    mesh.Compact();
    return mesh;
  }

  List<Point3d> PocketLipPoints(Point3d c, double w, double h, double d, double organic, int seed)
  {
    var pts = new List<Point3d>();
    for (int i = 0; i <= 24; i++)
    {
      double tu = (double)i / 24;
      double xNorm = (tu - 0.5) * 2.0;
      double x = c.X + xNorm * w * 0.62;
      double y = c.Y - d * (0.88 + 0.12 * (1.0 - Math.Abs(xNorm)));
      double z = c.Z + h * 0.52 + Math.Sin(tu * Math.PI * 2.0 + seed) * h * 0.035 * organic;
      pts.Add(new Point3d(x, y, z));
    }
    return pts;
  }

  List<Curve> PocketRibCurves(Point3d c, double w, double h, double d, double organic, int seed)
  {
    var ribs = new List<Curve>();
    for (int r = 0; r < 4; r++)
    {
      double s = 0.30 + r * 0.13;
      var pl = new Polyline();
      for (int i = 0; i <= 28; i++)
      {
        double tu = (double)i / 28;
        double xNorm = (tu - 0.5) * 2.0;
        double widthFactor = 0.42 + 0.42 * Math.Sin(s * Math.PI);
        double x = c.X + xNorm * w * 0.5 * widthFactor;
        double y = c.Y - d * (0.18 + 0.72 * SmoothStep(0.0, 1.0, s));
        double z = c.Z - h * 0.24 + h * s + Math.Sin(tu * Math.PI * 2.0 + seed) * h * 0.035 * organic;
        pl.Add(new Point3d(x, y - 0.02, z));
      }
      ribs.Add(pl.ToNurbsCurve());
    }
    return ribs;
  }

  List<Curve> DrainHoleCurves(Point3d c, double w, double h, double d)
  {
    var holes = new List<Curve>();
    for (int i = 0; i < 3; i++)
    {
      double x = c.X + (i - 1) * w * 0.14;
      double z = c.Z - h * 0.34;
      double y = c.Y - d * 0.82;
      Plane p = new Plane(new Point3d(x, y, z), Vector3d.YAxis);
      holes.Add(new Circle(p, Math.Max(0.045, w * 0.015)).ToNurbsCurve());
    }
    return holes;
  }

  double SmoothStep(double edge0, double edge1, double x)
  {
    double t = Math.Max(0.0, Math.Min(1.0, (x - edge0) / (edge1 - edge0)));
    return t * t * (3.0 - 2.0 * t);
  }
}
# ---------- end c_script ----------
c_script_2 = CSharpScript(
    W=number_slider_5,
    FloorH=number_slider_3,
    Levels=number_slider_4,
    PlantersPerLevel=number_slider,
    PlanterScale=Slider(1.2, range=0..10),
    Organic=number_slider_2,
    Seed=number_slider_6)  # -> ContourBandSurfaces, SmoothContourCurves, PocketGuideSurfaces, VaporBarrier, PocketSoils, BackPlates, Hooks, HookSlots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; inputs W: Double, FloorH: Double, Levels: Int32, PlantersPerLevel: Int32, PlanterScale: Double, Organic: Double, Seed: Int32
# ---------- c_script_2: C# ----------
// Grasshopper Script Instance
// Organic planter pocket - smooth contour rib version
//
// Rhino units: feet
//
// Inputs:
// W double                  // overall study width, e.g. 18
// FloorH double             // floor-to-floor height, e.g. 12
// Levels int                // e.g. 2 or 3
// PlantersPerLevel int      // e.g. 4, per row
// PlanterScale double       // e.g. 1.0
// Organic double            // 0 to 1, e.g. 0.75
// Seed int                  // e.g. 7
//
// Outputs:
// ContourBandSurfaces       // Brep, smooth modular contour band surfaces, inset 2 inches toward soil
// SmoothContourCurves       // Curve, clean contour loops for optional Pipe/Offset
// PocketGuideSurfaces       // Mesh, faint single-surface guide
// VaporBarrier              // Mesh, guide surface inset 0.75 inch toward soil with 0.1 inch inward thickness
// PocketSoils               // Mesh
// BackPlates                // Brep
// Hooks                     // Brep
// HookSlots                 // Brep, vertical adjustment slots on backplates
// Brackets                  // Brep
// DrainHoles                // Curve
// Plants                    // Mesh, low drooping planting ribbons
// PlantStems                // Brep, 0.25 inch diameter pipes from soil anchors to pocket lip
// Leaves                    // Mesh, small random leaf patches

#region Usings
using System;
using System.Linq;
using System.Collections;
using System.Collections.Generic;
using System.Drawing;

using Rhino;
using Rhino.Geometry;

using Grasshopper;
using Grasshopper.Kernel;
using Grasshopper.Kernel.Data;
using Grasshopper.Kernel.Types;
#endregion

public class Script_Instance : GH_ScriptInstance
{
  private void RunScript(
		double W,
		double FloorH,
		int Levels,
		int PlantersPerLevel,
		double PlanterScale,
		double Organic,
		int Seed,
		ref object ContourBandSurfaces,
		ref object SmoothContourCurves,
		ref object PocketGuideSurfaces,
		ref object VaporBarrier,
		ref object PocketSoils,
		ref object BackPlates,
		ref object Hooks,
		ref object HookSlots,
		ref object Brackets,
		ref object DrainHoles,
		ref object Plants,
		ref object PlantStems,
		ref object Leaves)
  {
    W = Math.Max(W, 8.0);
    FloorH = Math.Max(FloorH, 8.0);
    Levels = Math.Max(Levels, 1);
    PlantersPerLevel = Math.Max(PlantersPerLevel, 1);
    PlanterScale = Math.Max(PlanterScale, 0.35);
    Organic = Clamp(Organic, 0.0, 1.0);

    var bandSurfaces = new List<object>();
    var contourCurves = new List<object>();
    var guideSurfaces = new List<object>();
    var vaporBarriers = new List<object>();
    var soils = new List<object>();
    var backs = new List<object>();
    var hooks = new List<object>();
    var hookSlots = new List<object>();
    var brackets = new List<object>();
    var drains = new List<object>();
    var plants = new List<object>();
    var plantStems = new List<object>();
    var leaves = new List<object>();

    var random = new Random(Seed);
    double bayStep = W / PlantersPerLevel;
    double facadeY = 0.0;

    int rowsPerLevel = 2;

    for (int level = 0; level < Levels; level++)
    {
      for (int row = 0; row < rowsPerLevel; row++)
      {
        for (int j = 0; j < PlantersPerLevel; j++)
        {
          double u = PlantersPerLevel == 1 ? 0.5 : (double)j / (PlantersPerLevel - 1);
          double v = Levels == 1 ? 0.5 : (double)level / (Levels - 1);
          double rowT = rowsPerLevel == 1 ? 0.5 : (double)row / (rowsPerLevel - 1);

          double sizeBias =
            (0.82 + 0.24 * Math.Sin((u + 0.10) * Math.PI)) *
            (0.84 + 0.20 * Math.Sin((v + 0.16) * Math.PI)) *
            (0.92 + 0.10 * Math.Sin((rowT + 0.22) * Math.PI)) *
            (1.0 + 0.13 * Math.Sin(j * 1.71 + row * 0.61 + level * 0.83 + Seed * 0.13)) *
            (1.0 + (random.NextDouble() - 0.5) * 0.22 * Organic);

          double scale = PlanterScale * sizeBias;
          double x = -W * 0.5 + bayStep * (j + 0.5);
          x += (row == 0 ? -0.12 : 0.12) * bayStep;
          x += (random.NextDouble() - 0.5) * bayStep * 0.20 * Organic;

          // Two rows sit on a half-floor-height rhythm: 1/4 and 3/4 within each level.
          double rowCenter = (row + 0.5) / rowsPerLevel;
          double rowHookZ = level * FloorH + FloorH * rowCenter;
          double z = rowHookZ;

          double width = bayStep * (0.70 + 0.10 * Organic) * scale;
          double height = FloorH * (0.25 + 0.035 * Organic) * scale;
          double depth = (1.40 + 0.48 * Organic) * scale;

          PocketData pocket = MakePocket(
            new Point3d(x, facadeY, z),
            width,
            height,
            depth,
            rowHookZ,
            Organic,
            Seed + level * 97 + row * 53 + j * 31);

          foreach (Brep b in pocket.ContourBands) bandSurfaces.Add(b);
          foreach (Curve c in pocket.Contours) contourCurves.Add(c);
          guideSurfaces.Add(pocket.GuideSurface);
          vaporBarriers.Add(pocket.VaporBarrier);
          soils.Add(pocket.Soil);
          backs.Add(pocket.BackPlate);
          foreach (Brep b in pocket.Hooks) hooks.Add(b);
          foreach (Brep b in pocket.HookSlots) hookSlots.Add(b);
          foreach (Brep b in pocket.Brackets) brackets.Add(b);
          foreach (Curve c in pocket.DrainHoles) drains.Add(c);
          foreach (Mesh m in pocket.Plants) plants.Add(m);
          foreach (Brep b in pocket.PlantStems) plantStems.Add(b);
          foreach (Mesh m in pocket.Leaves) leaves.Add(m);
        }
      }
    }

    Print("Generated smooth contour pockets. Bands are single surfaces, inset 2 inches toward the soil side.");

    ContourBandSurfaces = bandSurfaces;
    SmoothContourCurves = contourCurves;
    PocketGuideSurfaces = guideSurfaces;
    VaporBarrier = vaporBarriers;
    PocketSoils = soils;
    BackPlates = backs;
    Hooks = hooks;
    HookSlots = hookSlots;
    Brackets = brackets;
    DrainHoles = drains;
    Plants = plants;
    PlantStems = plantStems;
    Leaves = leaves;
  }

  class PocketData
  {
    public List<Brep> ContourBands = new List<Brep>();
    public List<Curve> Contours = new List<Curve>();
    public Mesh GuideSurface;
    public Mesh VaporBarrier;
    public Mesh Soil;
    public Brep BackPlate;
    public List<Brep> Hooks = new List<Brep>();
    public List<Brep> HookSlots = new List<Brep>();
    public List<Brep> Brackets = new List<Brep>();
    public List<Curve> DrainHoles = new List<Curve>();
    public List<Mesh> Plants = new List<Mesh>();
    public List<Brep> PlantStems = new List<Brep>();
    public List<Mesh> Leaves = new List<Mesh>();
  }

  PocketData MakePocket(Point3d c, double width, double height, double depth, double rowHookZ, double organic, int seed)
  {
    var result = new PocketData();

    double printedLayerH = 1.0 / 12.0; // 1 inch in feet.
    int ribCount = Math.Max(8, (int)Math.Ceiling((height * 0.80) / printedLayerH) + 1);
    double contourStep = 1.0 / (ribCount - 1);

    for (int i = 0; i < ribCount; i++)
    {
      double t = ribCount == 1 ? 1.0 : (double)i / (ribCount - 1);
      double tCenter = t;
      Curve center = MakeContour(c, width, height, depth, tCenter, organic, seed);
      result.Contours.Add(center);

      // Each visible modular band is a single surface:
      // the contour is inset 2 inches toward the soil side, then extruded straight down one layer.
      if (i == 0) continue;

      double layerDrop = Math.Min(1.0 / 12.0, height * 0.80 * contourStep);
      Brep band = MakeContourBandSurface(
        c,
        width,
        height,
        depth,
        tCenter,
        2.0 / 12.0,
        layerDrop,
        organic,
        seed);

      if (band != null)
      {
        result.ContourBands.Add(band);
      }
    }

    result.GuideSurface = MakeGuideSurface(c, width, height, depth, organic, seed);
    result.VaporBarrier = MakeGuideShell(c, width, height, depth, organic, seed, 0.75 / 12.0, 0.10 / 12.0);

    double soilT = 3.0 / 4.0;
    result.Soil = MakeSoilFromContour(c, width, height, depth, soilT, 1.0 / 12.0, organic, seed);
    double soilZ = c.Z - height * 0.38 + height * 0.80 * soilT;

    AddBackPlateHooksAndSlots(result, c, width, height, depth, rowHookZ);

    AddBrackets(result, c, width, height, depth);
    AddDrainHoles(result, c, width, height, depth);
    AddPlants(result, c, width, height, depth, soilZ, organic, seed);
    return result;
  }

  Curve MakeContour(Point3d c, double width, double height, double depth, double t, double organic, int seed, double inset)
  {
    int count = 36;
    var pts = new List<Point3d>();

    double growth = 0.15 + 0.85 * SmoothStep(t);
    double halfW = width * 0.5 * growth;
    double d = depth * (0.13 + 0.87 * SmoothStep(t));
    double z = c.Z - height * 0.38 + height * 0.80 * t;

    // Superellipse section: closed, smooth, slightly squared at the back and round at the front.
    double n = 3.2 + organic * 0.8;
    double yCenter = c.Y - d * 0.50;

    for (int i = 0; i < count; i++)
    {
      double a = Math.PI * 2.0 * i / count;
      double ca = Math.Cos(a);
      double sa = Math.Sin(a);
      double sx = SignedPow(ca, 2.0 / n);
      double sy = SignedPow(sa, 2.0 / n);

      double frontBias = sy < 0.0 ? 1.0 + 0.10 * organic : 1.0 - 0.04 * organic;
      double x = c.X + sx * halfW;
      double y = yCenter + sy * d * 0.50 * frontBias;

      // Keep the back mounting side disciplined, but let the side/front lip breathe.
      if (sy > 0.72)
      {
        double k = (sy - 0.72) / 0.28;
        y = Lerp(y, c.Y - 0.035, Clamp(k, 0.0, 1.0));
      }

      double wave = Math.Sin(a * 3.0 + seed * 0.17) * Math.Sin(t * Math.PI);
      x += wave * width * 0.025 * organic;
      y += Math.Cos(a * 2.0 + seed * 0.11) * depth * 0.018 * organic * (1.0 - Math.Max(0.0, sy));

      if (inset > 0.0)
      {
        Vector3d inward = new Vector3d(c.X - x, yCenter - y, 0.0);
        if (inward.Length > 0.001)
        {
          inward.Unitize();
          x += inward.X * inset;
          y += inward.Y * inset;
        }
      }

      pts.Add(new Point3d(x, y, z));
    }

    pts.Add(pts[0]);
    return Curve.CreateInterpolatedCurve(pts, 3, CurveKnotStyle.Chord);
  }

  Curve MakeContour(Point3d c, double width, double height, double depth, double t, double organic, int seed)
  {
    return MakeContour(c, width, height, depth, t, organic, seed, 0.0);
  }

  Brep MakeContourBandSurface(
    Point3d c,
    double width,
    double height,
    double depth,
    double t,
    double baseInset,
    double layerDrop,
    double organic,
    int seed)
  {
    Curve outerCurve = MakeContour(c, width, height, depth, t, organic, seed, baseInset);
    Surface surface = Surface.CreateExtrusion(outerCurve, new Vector3d(0.0, 0.0, -layerDrop));
    if (surface == null) return null;
    return surface.ToBrep();
  }

  Mesh MakeGuideSurface(Point3d c, double width, double height, double depth, double organic, int seed)
  {
    return MakeGuideSurface(c, width, height, depth, organic, seed, 0.0);
  }

  Mesh MakeGuideSurface(Point3d c, double width, double height, double depth, double organic, int seed, double inset)
  {
    int rowCount = 18;
    int colCount = 80;
    var mesh = new Mesh();
    var ids = new int[rowCount, colCount];

    for (int r = 0; r < rowCount; r++)
    {
      double t = (double)r / (rowCount - 1);
      double growth = 0.15 + 0.85 * SmoothStep(t);
      double halfW = width * 0.5 * growth;
      double d = depth * (0.13 + 0.87 * SmoothStep(t));
      double z = c.Z - height * 0.38 + height * 0.80 * t;
      double n = 3.2 + organic * 0.8;
      double yCenter = c.Y - d * 0.50;

      for (int i = 0; i < colCount; i++)
      {
        double a = Math.PI * 2.0 * i / colCount;
        double ca = Math.Cos(a);
        double sa = Math.Sin(a);
        double sx = SignedPow(ca, 2.0 / n);
        double sy = SignedPow(sa, 2.0 / n);
        double frontBias = sy < 0.0 ? 1.0 + 0.10 * organic : 1.0 - 0.04 * organic;

        double x = c.X + sx * halfW;
        double y = yCenter + sy * d * 0.50 * frontBias;
        if (sy > 0.72)
        {
          double k = (sy - 0.72) / 0.28;
          y = Lerp(y, c.Y - 0.035, Clamp(k, 0.0, 1.0));
        }

        double wave = Math.Sin(a * 3.0 + seed * 0.17) * Math.Sin(t * Math.PI);
        x += wave * width * 0.025 * organic;
        y += Math.Cos(a * 2.0 + seed * 0.11) * depth * 0.018 * organic * (1.0 - Math.Max(0.0, sy));

        if (inset > 0.0)
        {
          Vector3d inward = new Vector3d(c.X - x, yCenter - y, 0.0);
          if (inward.Length > 0.001)
          {
            inward.Unitize();
            x += inward.X * inset;
            y += inward.Y * inset;
          }
        }

        ids[r, i] = mesh.Vertices.Add(x, y, z);
      }
    }

    for (int r = 0; r < rowCount - 1; r++)
    {
      for (int i = 0; i < colCount; i++)
      {
        int next = (i + 1) % colCount;
        mesh.Faces.AddFace(ids[r, i], ids[r, next], ids[r + 1, next], ids[r + 1, i]);
      }
    }

    mesh.Normals.ComputeNormals();
    mesh.Compact();
    return mesh;
  }

  Mesh MakeGuideShell(Point3d c, double width, double height, double depth, double organic, int seed, double baseInset, double thickness)
  {
    int rowCount = 18;
    int colCount = 80;
    var mesh = new Mesh();
    var outer = new int[rowCount, colCount];
    var inner = new int[rowCount, colCount];

    for (int r = 0; r < rowCount; r++)
    {
      double t = (double)r / (rowCount - 1);

      for (int i = 0; i < colCount; i++)
      {
        double a = Math.PI * 2.0 * i / colCount;
        Point3d po = GuideSurfacePoint(c, width, height, depth, t, a, organic, seed, baseInset);
        Point3d pi = GuideSurfacePoint(c, width, height, depth, t, a, organic, seed, baseInset + thickness);

        outer[r, i] = mesh.Vertices.Add(po);
        inner[r, i] = mesh.Vertices.Add(pi);
      }
    }

    for (int r = 0; r < rowCount - 1; r++)
    {
      for (int i = 0; i < colCount; i++)
      {
        int next = (i + 1) % colCount;
        mesh.Faces.AddFace(outer[r, i], outer[r, next], outer[r + 1, next], outer[r + 1, i]);
        mesh.Faces.AddFace(inner[r, next], inner[r, i], inner[r + 1, i], inner[r + 1, next]);
      }
    }

    for (int i = 0; i < colCount; i++)
    {
      int next = (i + 1) % colCount;
      mesh.Faces.AddFace(outer[0, next], outer[0, i], inner[0, i], inner[0, next]);
      mesh.Faces.AddFace(outer[rowCount - 1, i], outer[rowCount - 1, next], inner[rowCount - 1, next], inner[rowCount - 1, i]);
    }

    mesh.Normals.ComputeNormals();
    mesh.Compact();
    return mesh;
  }

  Point3d GuideSurfacePoint(Point3d c, double width, double height, double depth, double t, double a, double organic, int seed, double inset)
  {
    double growth = 0.15 + 0.85 * SmoothStep(t);
    double halfW = width * 0.5 * growth;
    double d = depth * (0.13 + 0.87 * SmoothStep(t));
    double z = c.Z - height * 0.38 + height * 0.80 * t;
    double n = 3.2 + organic * 0.8;
    double yCenter = c.Y - d * 0.50;

    double ca = Math.Cos(a);
    double sa = Math.Sin(a);
    double sx = SignedPow(ca, 2.0 / n);
    double sy = SignedPow(sa, 2.0 / n);
    double frontBias = sy < 0.0 ? 1.0 + 0.10 * organic : 1.0 - 0.04 * organic;

    double x = c.X + sx * halfW;
    double y = yCenter + sy * d * 0.50 * frontBias;

    if (sy > 0.72)
    {
      double k = (sy - 0.72) / 0.28;
      y = Lerp(y, c.Y - 0.035, Clamp(k, 0.0, 1.0));
    }

    double wave = Math.Sin(a * 3.0 + seed * 0.17) * Math.Sin(t * Math.PI);
    x += wave * width * 0.025 * organic;
    y += Math.Cos(a * 2.0 + seed * 0.11) * depth * 0.018 * organic * (1.0 - Math.Max(0.0, sy));

    if (inset > 0.0)
    {
      Vector3d inward = new Vector3d(c.X - x, yCenter - y, 0.0);
      if (inward.Length > 0.001)
      {
        inward.Unitize();
        x += inward.X * inset;
        y += inward.Y * inset;
      }
    }

    return new Point3d(x, y, z);
  }

  void AddBrackets(PocketData result, Point3d c, double width, double height, double depth)
  {
    double tube = Math.Max(0.07, Math.Min(width, height) * 0.035);
    double armZ = c.Z - height * 0.12;
    double armInsetX = width * 0.20;

    for (int s = -1; s <= 1; s += 2)
    {
      double bx = c.X + s * armInsetX;
      result.Brackets.Add(BoxBrep(
        new Point3d(bx - tube, c.Y - depth * 0.60, armZ - tube),
        new Point3d(bx + tube, c.Y + 0.04, armZ + tube)));

      result.Brackets.Add(BoxBrep(
        new Point3d(bx - tube * 1.7, c.Y - 0.07, armZ - height * 0.08),
        new Point3d(bx + tube * 1.7, c.Y + 0.07, armZ + height * 0.08)));
    }
  }

  void AddBackPlateHooksAndSlots(PocketData result, Point3d c, double width, double height, double depth, double rowHookZ)
  {
    double plateHalfW = width * 0.36;
    double plateBottom = c.Z - height * 0.22;
    double plateTop = c.Z + height * 0.34;
    double plateY0 = c.Y - 0.055;
    double plateY1 = c.Y + 0.055;

    double hookInsetX = width * 0.20;
    double hookW = Math.Max(0.18, width * 0.055);
    double hookDrop = Math.Max(0.75, height * 0.42);
    double hookD = Math.Max(0.34, depth * 0.22);
    double hookRodR = Math.Max(0.035, Math.Min(width, height) * 0.018);
    double pinR = Math.Max(0.065, hookD * 0.18);

    // Full-height vertical adjustment slots: same Z span as the corresponding backplate.
    double slotW = hookW * 0.42;
    double slotY0 = plateY0 - 0.02;
    double slotY1 = plateY1 + 0.02;

    for (int s = -1; s <= 1; s += 2)
    {
      double hx = c.X + s * hookInsetX;
      Brep slot = BoxBrep(
        new Point3d(hx - slotW * 0.5, slotY0, plateBottom),
        new Point3d(hx + slotW * 0.5, slotY1, plateTop));
      result.HookSlots.Add(slot);

      // Inverted J hook: long bearing leg on one side, 2 inch return after the crown.
      foreach (Brep b in MakeJHookPipe(hx, plateY1, rowHookZ, hookW, hookD, hookDrop, hookRodR))
      {
        result.Hooks.Add(b);
      }

      // Bearing washer/plate around the slot on the +Y side.
      result.Hooks.Add(BoxBrep(
        new Point3d(hx - hookW * 0.72, plateY1 + 0.004, rowHookZ - pinR * 1.35),
        new Point3d(hx + hookW * 0.72, plateY1 + 0.040, rowHookZ + pinR * 1.35)));
    }

    Brep plate = BoxBrep(
      new Point3d(c.X - plateHalfW, plateY0, plateBottom),
      new Point3d(c.X + plateHalfW, plateY1, plateTop));
    result.BackPlate = plate;
  }

  void AddDrainHoles(PocketData result, Point3d c, double width, double height, double depth)
  {
    for (int i = -1; i <= 1; i++)
    {
      Point3d p = new Point3d(c.X + i * width * 0.12, c.Y - depth * 0.50, c.Z - height * 0.26);
      result.DrainHoles.Add(new Circle(new Plane(p, Vector3d.YAxis), Math.Max(0.045, width * 0.015)).ToNurbsCurve());
    }
  }

  List<Brep> MakeJHookPipe(double x, double plateY, double pinZ, double hookW, double hookD, double hookDrop, double rodR)
  {
    var breps = new List<Brep>();
    var pts = new List<Point3d>();

    double yInner = plateY + hookD * 0.18;
    double yOuter = plateY + hookD;
    double cy = (yInner + yOuter) * 0.5;
    double r = (yOuter - yInner) * 0.5;
    double shortTail = 2.0 / 12.0;
    double longDrop = hookDrop * 0.60;

    pts.Add(new Point3d(x, yInner, pinZ - longDrop));
    pts.Add(new Point3d(x, yInner, pinZ));

    int arcSteps = 14;
    for (int i = 1; i <= arcSteps; i++)
    {
      double a = Math.PI - Math.PI * i / arcSteps;
      double y = cy + Math.Cos(a) * r;
      double z = pinZ + Math.Sin(a) * r;
      pts.Add(new Point3d(x, y, z));
    }

    pts.Add(new Point3d(x, yOuter, pinZ - shortTail));

    Curve rail = Curve.CreateInterpolatedCurve(pts, 3, CurveKnotStyle.Chord);
    if (rail == null) return breps;

    Brep[] pipe = Brep.CreatePipe(
      rail,
      rodR,
      false,
      PipeCapMode.Flat,
      true,
      0.01,
      Math.PI / 24.0);

    if (pipe != null)
    {
      for (int i = 0; i < pipe.Length; i++)
      {
        if (pipe[i] != null) breps.Add(pipe[i]);
      }
    }

    return breps;
  }

  void AddPlants(PocketData result, Point3d c, double width, double height, double depth, double soilZ, double organic, int seed)
  {
    var random = new Random(seed + 509);
    int plantCount = 7 + (int)Math.Round(organic * 7.0);

    for (int i = 0; i < plantCount; i++)
    {
      double tx = (plantCount == 1) ? 0.5 : (double)i / (plantCount - 1);
      double sx = (tx - 0.5) * 2.0;
      double baseX = c.X + sx * width * (0.20 + 0.10 * random.NextDouble());
      double baseY = c.Y - depth * (0.38 + 0.22 * random.NextDouble());
      double baseZ = soilZ + 0.08 + random.NextDouble() * height * 0.05;
      Point3d soilAnchor = new Point3d(baseX, baseY, baseZ);

      // Plant leaves now start from the upper/front lip of the pocket.
      // The original soil point is only a lower anchor for the small stem pipe.
      double lipZ = c.Z + height * 0.42;
      double lipX = c.X + sx * width * (0.28 + 0.08 * random.NextDouble());
      double lipY = c.Y - depth * (0.88 + 0.08 * random.NextDouble());
      Point3d lipAnchor = new Point3d(
        lipX,
        lipY,
        lipZ);

      double xDrift = (random.NextDouble() - 0.5) * width * 0.22;
      double outward = depth * (0.16 + random.NextDouble() * 0.24);
      double lift = height * (0.08 + random.NextDouble() * 0.08);
      double drop = height * (0.20 + random.NextDouble() * 0.28);
      double bladeW = width * (0.018 + random.NextDouble() * 0.018);

      Brep stem = MakePipeBetween(soilAnchor, lipAnchor, 0.125 / 12.0);
      if (stem != null) result.PlantStems.Add(stem);

      Mesh blade = MakeDroopingPlantRibbon(
        lipAnchor,
        xDrift,
        outward,
        lift,
        drop,
        bladeW,
        seed + i * 37);
      result.Plants.Add(blade);

      int leafCount = 2 + random.Next(3);
      for (int k = 0; k < leafCount; k++)
      {
        double t = 0.28 + random.NextDouble() * 0.58;
        Point3d leafC = PlantRibbonPoint(lipAnchor, xDrift, outward, lift, drop, t, seed + i * 37);
        double side = random.NextDouble() < 0.5 ? -1.0 : 1.0;
        result.Leaves.Add(MakeLeafPatch(
          leafC,
          side,
          width * (0.035 + random.NextDouble() * 0.030),
          height * (0.030 + random.NextDouble() * 0.030),
          random.NextDouble() * Math.PI));
      }
    }
  }

  Brep MakePipeBetween(Point3d a, Point3d b, double radius)
  {
    if (a.DistanceTo(b) < 0.001) return null;

    Curve rail = new LineCurve(a, b);
    Brep[] pipe = Brep.CreatePipe(
      rail,
      radius,
      false,
      PipeCapMode.Flat,
      true,
      0.01,
      Math.PI / 18.0);

    if (pipe == null || pipe.Length == 0) return null;
    return pipe[0];
  }

  Mesh MakeDroopingPlantRibbon(Point3d basePt, double xDrift, double outward, double lift, double drop, double bladeW, int seed)
  {
    int seg = 7;
    var mesh = new Mesh();
    var random = new Random(seed);

    for (int i = 0; i <= seg; i++)
    {
      double t = (double)i / seg;
      Point3d p = PlantRibbonPoint(basePt, xDrift, outward, lift, drop, t, seed);
      double wobble = (random.NextDouble() - 0.5) * bladeW * 0.45;
      double w = bladeW * (1.0 - 0.55 * t);
      mesh.Vertices.Add(p.X - w + wobble, p.Y, p.Z);
      mesh.Vertices.Add(p.X + w + wobble, p.Y, p.Z);
    }

    for (int i = 0; i < seg; i++)
    {
      int a = i * 2;
      mesh.Faces.AddFace(a, a + 1, a + 3, a + 2);
    }

    mesh.Normals.ComputeNormals();
    mesh.Compact();
    return mesh;
  }

  Point3d PlantRibbonPoint(Point3d basePt, double xDrift, double outward, double lift, double drop, double t, int seed)
  {
    double sway = Math.Sin(t * Math.PI * 2.0 + seed * 0.31) * 0.08 * t;
    double s = SmoothStep(t);
    double x = basePt.X + xDrift * s + sway;
    double y = basePt.Y - outward * s;
    double z = basePt.Z + lift * Math.Sin(t * Math.PI) - drop * s;
    return new Point3d(x, y, z);
  }

  Mesh MakeLeafPatch(Point3d c, double side, double w, double h, double angle)
  {
    var mesh = new Mesh();
    double ca = Math.Cos(angle);
    double sa = Math.Sin(angle);
    Vector3d xAxis = new Vector3d(side * ca, -0.20, sa * 0.25);
    Vector3d zAxis = new Vector3d(-side * sa * 0.15, -0.08, ca);
    xAxis.Unitize();
    zAxis.Unitize();

    mesh.Vertices.Add(c - xAxis * w * 0.15);
    mesh.Vertices.Add(c + xAxis * w + zAxis * h * 0.35);
    mesh.Vertices.Add(c + xAxis * w * 1.75);
    mesh.Vertices.Add(c + xAxis * w - zAxis * h * 0.45);
    mesh.Faces.AddFace(0, 1, 2, 3);
    mesh.Normals.ComputeNormals();
    mesh.Compact();
    return mesh;
  }

  Mesh MakeSoilFromContour(Point3d c, double width, double height, double depth, double contourT, double inset, double organic, int seed)
  {
    int sampleCount = 72;
    int ringCount = 5;
    Curve contour = MakeContour(c, width, height, depth, contourT, organic, seed);

    Point3d[] boundary;
    double[] parameters = contour.DivideByCount(sampleCount, false, out boundary);
    if (parameters == null || boundary == null || boundary.Length < 8)
    {
      return MakeSoilSurfaceFallback(c, width * 0.62, depth * 0.46, c.Y - depth * 0.48, c.Z + height * 0.15, organic, seed);
    }

    Point3d center = AveragePoint(boundary);
    double soilZ = c.Z - height * 0.38 + height * 0.80 * contourT + height * 0.025;
    center = new Point3d(center.X, center.Y, soilZ + height * 0.018);

    var mesh = new Mesh();
    int centerId = mesh.Vertices.Add(center);
    var ids = new int[ringCount + 1, boundary.Length];

    for (int r = 1; r <= ringCount; r++)
    {
      double tr = (double)r / ringCount;
      for (int i = 0; i < boundary.Length; i++)
      {
        Point3d p = boundary[i];
        Vector3d radial = new Vector3d(p.X - center.X, p.Y - center.Y, 0.0);
        double len = radial.Length;
        if (len > 0.001)
        {
          radial.Unitize();
          p = new Point3d(p.X - radial.X * inset, p.Y - radial.Y * inset, p.Z);
        }

        double wave = Math.Sin(i * Math.PI * 2.0 / boundary.Length * 3.0 + seed * 0.21) * 0.018 * organic;
        Point3d q = LerpPoint(center, new Point3d(p.X, p.Y, soilZ + wave), tr);
        ids[r, i] = mesh.Vertices.Add(q);
      }
    }

    for (int i = 0; i < boundary.Length; i++)
    {
      int next = (i + 1) % boundary.Length;
      mesh.Faces.AddFace(centerId, ids[1, i], ids[1, next]);
    }

    for (int r = 1; r < ringCount; r++)
    {
      for (int i = 0; i < boundary.Length; i++)
      {
        int next = (i + 1) % boundary.Length;
        mesh.Faces.AddFace(ids[r, i], ids[r + 1, i], ids[r + 1, next], ids[r, next]);
      }
    }

    mesh.Normals.ComputeNormals();
    mesh.Compact();
    return mesh;
  }

  Point3d AveragePoint(Point3d[] pts)
  {
    double x = 0.0;
    double y = 0.0;
    double z = 0.0;
    for (int i = 0; i < pts.Length; i++)
    {
      x += pts[i].X;
      y += pts[i].Y;
      z += pts[i].Z;
    }
    double n = Math.Max(1, pts.Length);
    return new Point3d(x / n, y / n, z / n);
  }

  Mesh MakeSoilSurfaceFallback(Point3d c, double width, double depth, double y, double z, double organic, int seed)
  {
    int xCount = 18;
    int yCount = 12;
    var mesh = new Mesh();
    var ids = new int[yCount + 1, xCount + 1];

    for (int iy = 0; iy <= yCount; iy++)
    {
      double ty = (double)iy / yCount;
      double yy = y + (ty - 0.5) * depth;
      double taper = 0.70 + 0.30 * Math.Sin(ty * Math.PI);

      for (int ix = 0; ix <= xCount; ix++)
      {
        double tx = (double)ix / xCount;
        double sx = tx * 2.0 - 1.0;
        double zz = z + Math.Sin(tx * Math.PI * 2.0 + seed * 0.21) * 0.018 * organic;
        double xx = c.X + sx * width * 0.5 * taper;
        ids[iy, ix] = mesh.Vertices.Add(xx, yy, zz);
      }
    }

    for (int iy = 0; iy < yCount; iy++)
    {
      for (int ix = 0; ix < xCount; ix++)
      {
        int a = ids[iy, ix];
        int b = ids[iy, ix + 1];
        int d = ids[iy + 1, ix + 1];
        int cc = ids[iy + 1, ix];
        mesh.Faces.AddFace(a, b, d, cc);
      }
    }

    mesh.Normals.ComputeNormals();
    mesh.Compact();
    return mesh;
  }

  Brep BoxBrep(Point3d a, Point3d b)
  {
    var x = new Interval(Math.Min(a.X, b.X), Math.Max(a.X, b.X));
    var y = new Interval(Math.Min(a.Y, b.Y), Math.Max(a.Y, b.Y));
    var z = new Interval(Math.Min(a.Z, b.Z), Math.Max(a.Z, b.Z));
    return new Box(Plane.WorldXY, x, y, z).ToBrep();
  }

  double SmoothStep(double t)
  {
    t = Clamp(t, 0.0, 1.0);
    return t * t * (3.0 - 2.0 * t);
  }

  double SignedPow(double x, double p)
  {
    return Math.Sign(x) * Math.Pow(Math.Abs(x), p);
  }

  double Lerp(double a, double b, double t)
  {
    return a + (b - a) * t;
  }

  Point3d LerpPoint(Point3d a, Point3d b, double t)
  {
    return new Point3d(Lerp(a.X, b.X, t), Lerp(a.Y, b.Y, t), Lerp(a.Z, b.Z, t));
  }

  double Clamp(double x, double lo, double hi)
  {
    return Math.Max(lo, Math.Min(hi, x));
  }
}
# ---------- end c_script_2 ----------
geo = Geometry(c_script.PrimaryStructure)
geo_2 = Geometry(c_script.MeshInfill)
geo_3 = Geometry(c_script.PocketSupports)
geo_4 = Geometry(c_script.Plants)
geo_5 = Geometry(c_script.PocketModules)
geo_6 = Geometry(c_script.Roof)
geo_7 = Geometry(c_script.Armature)
geo_8 = Geometry(c_script.SpandrelEnvelope)
geo_9 = Geometry(c_script.CorridorStructure)
geo_10 = Geometry(c_script.GlazingSystem)
geo_11 = Geometry(c_script_2.Brackets)
geo_12 = Geometry(c_script_2.HookSlots)
geo_13 = Geometry(c_script_2.SmoothContourCurves)
geo_14 = Geometry(c_script_2.ContourBandSurfaces)
geo_15 = Geometry(c_script_2.BackPlates)
geo_16 = Geometry(c_script_2.PlantStems)
geo_17 = Geometry(c_script_2.Leaves)
geo_18 = Geometry(c_script_2.Hooks)
geo_19 = Geometry(c_script_2.Plants)
geo_20 = Geometry(c_script_2.PocketGuideSurfaces)
geo_21 = Geometry(c_script_2.PocketSoils)
geo_22 = Geometry(c_script_2.VaporBarrier)
pipe = Pipe(Curve=geo_13, Radius=0.05, Caps=0, FitRail=False)
mjoin = MeshJoin(Meshes=pipe)
panel = Panel(mjoin)
